# Grasshopper definition BrepTest.ghx (Grasshopper 1.0.7)
# plug-ins: Speckle 2, MeshEdit Components, Human

number_slider = Slider(3, range=0..10)
number_slider_2 = Slider(0.4, range=0..1)
number_slider_3 = Slider(2, range=0..10)
range = Range(Domain="-2 to 2", Steps=number_slider)
pt = Point(Point(0, -0.2430274182, 0))
pt_2 = Point(Point(-0.2375516705, 0.07208809119, -0.2489613433))
pt_3 = Point(Point(0.7966847394, 0.07208809119, 0.135139581))
pt_4 = Point(Point(0.7966847394, 0.07208809119, 1.252480454))
pt_5 = ConstructPoint(XCoordinate=graft(range), YCoordinate=range, ZCoordinate=0)
cyl = Cylinder(Base=pt, Radius=0.5, Length=Slider(1, range=0..10))
box = CenterBox(Base=pt_4, X=number_slider_2, Y=number_slider_2, Z=number_slider_3)
box_2 = CenterBox(Base=pt_3, X=number_slider_3, Y=number_slider_2, Z=number_slider_2)
box_3 = CenterBox(Base=pt_2, X=number_slider_2, Y=number_slider_3, Z=number_slider_2)
box_4 = CenterBox(Base=PlaneXY(0, 0, 0), X=1, Y=1, Z=1)
cap = CapHoles(Brep=cyl)
brep = Brep(box_4)
pt_6 = Point(Tree({0;0;0}: [Point(-2, -2, 0), Point(-2, -0.6666666667, 0), Point(-2, 0.6666666667, 0), Point(-2, 2, 0)], {0;0;1}: [Point(-0.6666666667, -2, 0), Point(-0.6666666667, -0.6666666667, -1.468956097), Point(-0.6666666667, 0.6666666667, 1.305453651), Point(-0.6666666667, 2, -0.9238310205)], {0;0;2}: [Point(0.6666666667, -2, 0), Point(0.6666666667, -0.6666666667, 2.759774879), Point(0.6666666667, 0.6666666667, -0.1358726263), Point(0.6666666667, 2, 0)], {0;0;3}: [Point(2, -2, -1.643371203), Point(2, -0.6666666667, 0), Point(2, 0.6666666667, 0), Point(2, 2, 0)]))
pt_7 = Point(Tree({0;0;0}: [Point(-2, 0, -2), Point(-2, 0, -0.6666666667), Point(-2, -1.157601878, 0.6666666667), Point(-2, -1.531644715, 2)], {0;0;1}: [Point(-0.6666666667, 0, -2), Point(-0.6666666667, -0.339197191, -0.6666666667), Point(-0.6666666667, 2.598013607, 0.6666666667), Point(-0.6666666667, 0, 2)], {0;0;2}: [Point(0.6666666667, -1.084035409, -2), Point(0.6666666667, 0.2769907449, -0.6666666667), Point(0.2187878199, -0.6758975856, 0.6666666667), Point(0.6666666667, -0.9859577286, 2)], {0;0;3}: [Point(2, 0, -2), Point(2, 2.242105939, -0.6666666667), Point(2, 0, 0.6666666667), Point(2, 0, 2)]))
relay = Relay([box, box_2, box_3])
srfgrid = SurfaceFromPoints(Points=flatten(pt_6), UCount=expr("x+1", number_slider), Interpolate=False)
srfgrid_2 = SurfaceFromPoints(Points=flatten(pt_7), UCount=expr("x+1", number_slider), Interpolate=invert(True))
Z = UnitZ(Factor=Slider(0.5687, range=-1..1))
move = Move(Geometry=srfgrid, Motion=Z)  # -> Geometry, Transform
flip = Flip(Surface=move.Geometry)  # -> Surface, Result
relay_2 = Relay([move.Geometry, srfgrid_2])
sdiff = SolidDifference(BrepsA=brep, BrepsB=cap)
sdiff_2 = SolidDifference(BrepsA=brep, BrepsB=relay)
sdiff_3 = SolidDifference(BrepsA=brep, BrepsB=box_3)
sdiff_4 = SolidDifference(BrepsA=sdiff_2, BrepsB=cap)
sunion = SolidUnion(Breps=[srfgrid, srfgrid_2])
sdiff_5 = SolidDifference(BrepsA=sdiff_4, BrepsB=flip.Surface)
pt_8 = Point([Point(-7.817333337, -6.253343826, 0), Point(-10.02456968, 4.172836202, 1.830920992), Point(10.16226121, 8.408412446, 0), Point(8.777132862, -4.740103994, 0), Point(28.25383308, -7.153124511, 0), Point(27.50993698, 8.01810969, 0)])
edges = BrepEdges(Brep=sdiff_4)  # -> Naked, Interior, NonManifold
item = ListItem(List=pt_8, Index=0, Wrap=True)  # -> Item, Item1, Item2, Item3, Item4, Item5

number_slider_4 = Slider(1, range=0..1)
srf = Surface(reparameterize(srfgrid_2))
pt_9 = Point([Point(0.2304264784, 0.1245065727, 0), Point(0.1174252386, 0.5301330901, 0), Point(0.4398833213, 0.8202184117, 0), Point(0.8470526571, 0.4339624696, 0), Point(0.7045404598, 0.1754018585, 0)])
rectangle = Rectangle(Plane=PlaneXY(0, 0, 0), XSize=number_slider_4, YSize=number_slider_4, Radius=0)  # -> Rectangle, Length
srf_2 = Surface(reparameterize(rectangle.Rectangle))
pline = PolyLine(Vertices=pt_9, Closed=invert(False))
nurbs = NurbsCurve(Vertices=pt_9, Degree=3, Periodic=invert(False))  # -> Curve, Length, Domain
explode = Explode(Curve=pline, Recursive=True)  # -> Segments, Vertices
map_srf = MapToSurface(Curve=nurbs.Curve, Source=srf_2, Target=srf)
panel = Panel("""0.5
1""")
shatter = Shatter(Curve=reparameterize(map_srf), Parameters=panel)
srfsplit = SurfaceSplit(Surface=srf, Curves=shatter)
item_2 = ListItem(List=srfsplit, Index=0, Wrap=True)  # -> Item, Item1

preview = CustomPreview(Geometry=sdiff_4, Material=ColourSwatch(SwatchColor=RGB(255, 255, 255)))
srf4pt = _4PointSurface(CornerA=item.Item, CornerB=item.Item1, CornerC=item.Item2, CornerD=item.Item3)
srf4pt_2 = _4PointSurface(CornerA=item.Item3, CornerB=item.Item2, CornerC=item.Item5, CornerD=item.Item4)
previewlw = CustomPreviewLineweights(
    Geometry=edges.Interior,
    Shader={diffuse=RGB(255, 105, 180), emission=RGB(76, 32, 54), shine=0.5, specular=RGB(255, 255, 255), transparency=0},
    Thickness=Slider(5, range=0..10),
    Absolute=False)
join = BrepJoin(Breps=[srf4pt, srf4pt_2])  # -> Breps, Closed

msphereex = MeshSphereEx(Base=PlaneXY(0, 0, 0), Radius=10, Count=5)
explode_2 = MeshExplode(Mesh=msphereex, Interpolate=False)
split = SplitList(List=explode_2, Index=Slider(100, range=0..100))  # -> ListA, ListB
demesh = DeconstructMesh(Mesh=split.ListA)  # -> Vertices, Faces, Colours, Normals
item_3 = ListItem(List=demesh.Vertices, Index=0, Wrap=True)  # -> Item, Item1, Item2, Item3, Item4
srf4pt_3 = _4PointSurface(CornerA=item_3.Item, CornerB=item_3.Item1, CornerC=item_3.Item2, CornerD=item_3.Item3)
join_2 = BrepJoin(Breps=flatten(srf4pt_3))  # -> Breps, Closed

md_slider = MDSlider(
    SliderMode=0,
    slider_value=Point(0.04854523189, 0.9682475765, 0.5),
    x_domain=Domain(0, 1),
    y_domain=Domain(0, 1),
    z_domain=Domain(0, 1))
evalsrf = EvaluateSurface(Surface=reparameterize(srfgrid_2), Point=md_slider)  # -> Point, Normal, UDirection, VDirection, Frame
box_5 = CenterBox(Base=evalsrf.Frame, X=1, Y=1, Z=1)
split_2 = SplitBrep(Brep=srfgrid_2, Cutter=box_5)
item_4 = ListItem(List=split_2, Index=0, Wrap=True)

pt_10 = Point(Point(0.6442965029, -0.01086970551, 0))
pt_11 = Point([Point(6.933961729, -3.869629055, 0), Point(1.136003693, -4.208899822, 0), Point(-1.896360791, 0.3341178344, 0), Point(1.091799117, 4.477686545, 0), Point(5.849853553, 4.470350256, 0), Point(6.017103486, -0.02678989034, 0)])
pline_2 = PolyLine(Vertices=pt_11, Closed=invert(False))
pt_12 = Point(Point(20.57298753, 0, 0))
box_6 = CenterBox(Base=pt_10, X=1, Y=1, Z=1)
cir = Circle(Plane=pt_12, Radius=Slider(5, range=0..10))
pt_13 = Point(Point(1, 1, 1))
pt_14 = Point(Point(0, 0, 0))
split_3 = SplitBrep(Brep=join.Breps, Cutter=box_6)
srfsplit_2 = SurfaceSplit(Surface=srf4pt, Curves=pline_2)
box_7 = Box2Pt(PointA=pt_14, PointB=pt_13, Plane=PlaneXY(0, 0, 0))
srfsplit_3 = SurfaceSplit(Surface=srf4pt_2, Curves=cir)
item_5 = ListItem(List=srfsplit_2, Index=0, Wrap=True)  # -> Item, Item1
item_6 = ListItem(List=split_3, Index=0, Wrap=True)
item_7 = ListItem(List=srfsplit_3, Index=0, Wrap=True)  # -> Item, Item1
brep_2 = Brep(box_7)
brep_3 = Brep([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])
brep_4 = Brep(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)
edges_2 = BrepEdges(Brep=item_2.Item)  # -> Naked, Interior, NonManifold
bbox = BoundingBox(Content=brep_4, Plane=PlaneXY(0, 0, 0))  # -> Box, Box_2
boxprop = BoxProperties(Box=bbox.Box)  # -> Center, Diagonal, Area, Volume, Degeneracy
neg = Negative(Value=boxprop.Center)
item_8 = ListItem(List=edges_2.Naked, Index=0, Wrap=True)
move_2 = Move(Geometry=brep_4, Motion=neg)  # -> Geometry, Transform
c_script = CSharpScript(x=item_2.Item1)  # -> out, A; inputs x: Brep
# ---------- c_script: C# ----------
    x.Repair(0.0001);
    A = x;
# ---------- end c_script ----------
scale = Scale(Geometry=move_2.Geometry, Center=Point(0, 0, 0), Factor=Slider(5, range=0..10))  # -> Geometry, Transform
data = Data(shatter)
cp = ControlPoints(Curve=item_8)  # -> Points, Weights, Knots
edges_3 = BrepEdges(Brep=sdiff_5)  # -> Naked, Interior, NonManifold
panel_2 = Panel("""Cube
CubeWithHole
Complex
FaceWithHole
TrimmedFace
TrimmedFaceSingleLoop
TwoFaces
TwoFacesWithHole
QuadDome
NurbsWithHole
FaceWithTrimmedEdge""")
split_4 = SplitList(List=edges_3.Interior, Index=Slider(56, range=0..100))  # -> ListA, ListB
panel_3 = Panel(edges_3.Interior)
entwine = Entwine(
    Branch00=brep_2,
    Branch01=sdiff_3,
    Branch02=sdiff_5,
    Branch03=item_7.Item,
    Branch04=item_2.Item1,
    Branch05=item_7.Item1,
    Branch06=join.Breps,
    Branch07=item_6,
    Branch08=join_2.Breps,
    Branch09=item_2.Item,
    Branch010=scale.Geometry,
    FlattenInputs=True)
item_9 = ListItem(List=split_4.ListB, Index=Slider(13, range=0..15), Wrap=True)
concat = Concatenate(FragmentA="Brep-", FragmentB=panel_2)  # -> graft(Result)
scale_2 = Scale(Geometry=entwine, Center=Point(0, 0, 0), Factor="1000")  # -> Geometry, Transform
c_script_2 = CSharpScript(x=item_9)  # -> out, A, B, C; inputs x: Curve
# ---------- c_script_2: C# ----------
    var n = x.ToNurbsCurve();
    B = x.Rebuild(n.Points.Count, n.Degree, true);
    var c = x.Fit(n.Degree, 0.000001, 0.000001);
    //n.Knots.RemoveMultipleKnots(0, n.Degree + 1, 0);

    C = c;
    A = n;
    for(var i = n.Degree; i < n.Knots.Count - n.Degree; i++){
      var mult = n.Knots.KnotMultiplicity(i);
      i += mult - 1;
      Print(mult.ToString());
    }
# ---------- end c_script_2 ----------
cp_2 = ControlPoints(Curve=item_9)  # -> Points, Weights, Knots
knots = KnotVector(Count=Slider(3, range=0..10), Degree=Slider(2, range=0..10), Periodic=False)

to_speckle = ToSpeckle(Objects=scale_2.Geometry, KitName="Objects")
srl = Serialize(O=to_speckle)

cp_3 = ControlPoints(Curve=c_script_2.B)  # -> Points, Weights, Knots
panel_4 = Panel(c_script_2.out)
lng = ListLength(List=cp_3.Points)

brep_5 = Brep(item_6)
debrep = DeconstructBrep(Brep=brep_5)  # -> Faces, Edges, Vertices
pt_15 = Point(Point(0.5, 0.5, 0))
evalsrf_2 = EvaluateSurface(Surface=reparameterize(debrep.Faces), Point=pt_15)  # -> flatten(Point), Normal, UDirection, VDirection, Frame
curvepoint = PointOnCurve(debrep.Edges, parameter=0.5)
end = EndPoints(Curve=debrep.Edges)  # -> Start, End
subtraction = Subtraction(A=end.End, B=end.Start)
lng_2 = ListLength(List=evalsrf_2.Point)
lng_3 = ListLength(List=curvepoint)
series = Series(Start=0, Step=1, Count=lng_2)
series_2 = Series(Start=0, Step=1, Count=lng_3)
tag = TextTag(Location=curvepoint, Text=series_2, Colour=ColourSwatch(SwatchColor=RGB(0, 80, 199)))
vdis = VectorDisplay(Anchor=end.Start, Vector=subtraction)
tag_2 = TextTag(Location=evalsrf_2.Point, Text=series, Colour=ColourSwatch(SwatchColor=RGB(0, 0, 0)))

panel_5 = Panel(lng)
panel_6 = Panel(cp_3.Knots)

# ---- group: Serialize/Deserialize
to_speckle_2 = ToSpeckle(Objects=scale.Geometry, KitName="Objects")
srl_2 = Serialize(O=to_speckle_2)
deserialize = Deserialize(O=srl_2)
to_native = ToNative(Objects=deserialize, KitName="Objects")
brep_6 = Brep(to_native)
preview_2 = CustomPreview(Geometry=brep_6, Material=ColourSwatch(SwatchColor=RGB(181, 228, 255)))

# ----
flatten = FlattenTree(Tree=to_speckle, Path="{0}")
panel_7 = Panel(flatten)
path = FilePath("Y:\Documents\Speckle\speckle-sharp\Objects\Converters\ConverterRevit\TestModels\")
c_script_3 = CSharpScript(contents=srl, folderPath=path, fileName=concat)  # -> A; inputs contents: String, folderPath: String, fileName: String
# ---------- c_script_3: C# ----------
    System.IO.File.WriteAllText(folderPath + fileName + ".json", contents);
# ---------- end c_script_3 ----------
number_slider_5 = Slider(4, range=0..10)
pt_16 = Point([Point(-6.801964762, -4.793113776, 6.064103075), Point(-6.71707748, 9.964966405, 0), Point(9.567200842, 9.209756521, 3.836280563), Point(7.916250609, -5.094432938, 0)])
item_10 = ListItem(List=pt_16, Index=0, Wrap=True)  # -> Item, Item1, Item2, Item3
series_3 = Series(Start=0, Step=1, Count=number_slider_5)
srf4pt_4 = _4PointSurface(CornerA=item_10.Item, CornerB=item_10.Item1, CornerC=item_10.Item2, CornerD=item_10.Item3)
pt_17 = Point(Point(0.5, 0.5, 0))
pt_18 = ConstructPoint(XCoordinate=graft(series_3), YCoordinate=series_3, ZCoordinate=0)
eso = ExpandSpeckleObject(SpeckleObject=to_speckle_2)  # -> Area, Curve2D, Curve3D, DisplayValue, Edges, Faces, IsClosed, Loops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
pt_19 = Point(Tree({0;0;0}: [Point(0, 0, 0), Point(0, 1, 0), Point(0, 2, 0), Point(0, 3, 0)], {0;0;1}: [Point(1, 0, 0), Point(1, 1, 1.378930523), Point(1, 2, 0), Point(1, 3, 0)], {0;0;2}: [Point(2, 0, 0), Point(2, 1, 0), Point(2, 2, 0), Point(2, 3, 0)], {0;0;3}: [Point(3, 0, 0), Point(3, 1, 0), Point(3, 2, 0), Point(3, 3, 0)]))
srfgrid_3 = SurfaceFromPoints(Points=flatten(pt_19), UCount=number_slider_5, Interpolate=invert(False))
evalsrf_3 = EvaluateSurface(Surface=reparameterize(srfgrid_3), Point=pt_17)  # -> Point, Normal, UDirection, VDirection, Frame
box_8 = CenterBox(Base=evalsrf_3.Point, X=1, Y=1, Z=1)
sdiff_6 = SolidDifference(BrepsA=srfgrid_3, BrepsB=box_8)
split_5 = SplitBrep(Brep=srfgrid_3, Cutter=box_8)
eso_2 = ExpandSpeckleObject(SpeckleObject=eso.Edges)  # -> Brep, Curve, Curve3dIndex, Domain, EndIndex, EndVertex, ProxyCurveIsReversed, StartIndex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
eso_3 = ExpandSpeckleObject(SpeckleObject=eso.Loops)  # -> Brep, Face, FaceIndex, TrimIndices, Trims, Type
item_11 = ListItem(List=split_5, Index=0, Wrap=True)
scale_3 = Scale(Geometry=sunion, Center=Point(0, 0, 0), Factor="1000")  # -> Geometry, Transform
to_speckle_3 = ToSpeckle(Objects=scale_3.Geometry, KitName="Objects")
eso_4 = ExpandSpeckleObject(SpeckleObject=eso_3.Trims)  # -> Brep, Curve2d, CurveIndex, Domain, Edge, EdgeIndex, Face, FaceIndex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
srl_3 = Serialize(O=to_speckle_3)
domain = Domain(flatten(eso_2.Domain))
domain_2 = Domain(flatten(eso_2.Curve))
panel_8 = Panel(domain_2)
panel_9 = Panel(eso_4.Loop)
c_script_4 = CSharpScript(contents=srl_3, folderPath=path, fileName="Brep-SimpleHyparHole")  # -> A; inputs contents: String, folderPath: String, fileName: String; same code as c_script_3
