# Grasshopper definition SurfaceTests.ghx (Grasshopper 1.0.7)
# plug-ins: Speckle 2

number_slider = Slider(4, range=0..10)
accounts = Accounts(
    {"Account (alan@rynne.es | https://staging.speckle.dev)": "ead7b5bb692081ceb2ed3cde2b088187", "Account (alan@rynne.es | http://localhost:3000)": "c17e3b5af2f177869a733cca10850355", "Account (alan@speckle.systems | https://staging.speckle.dev)": "4f3b8d2197550b86f070c641aebd21a8"}, selected="Account (alan@rynne.es | http://localhost:3000)",
    selectedId="c17e3b5af2f177869a733cca10850355",
    selectedServer="http://localhost:3000")
accounts_2 = Accounts(
    {"Account (alan@rynne.es | https://staging.speckle.dev)": "ead7b5bb692081ceb2ed3cde2b088187", "Account (alan@rynne.es | http://localhost:3000)": "c17e3b5af2f177869a733cca10850355", "Account (alan@speckle.systems | https://staging.speckle.dev)": "4f3b8d2197550b86f070c641aebd21a8"}, selected="Account (alan@rynne.es | https://staging.speckle.dev)",
    selectedId="ead7b5bb692081ceb2ed3cde2b088187",
    selectedServer="https://staging.speckle.dev")
series = Series(Start=0, Step=1, Count=number_slider)
construct_point = ConstructPoint(XCoordinate=graft(series), YCoordinate=series, ZCoordinate=0)
id_cc631d854e = CreateStream(Account=accounts, stream="cc631d854e http://localhost:3000 c17e3b5af2f177869a733cca10850355")
id_7ed7a7d55e = CreateStream(Account=accounts_2, stream="7ed7a7d55e https://staging.speckle.dev ead7b5bb692081ceb2ed3cde2b088187")
receive = Receive(
    Stream=id_7ed7a7d55e,
    AutoReceive=True,
    CurrentComponentState="up_to_date",
    KitName="Objects",
    LastInfoMessage="Alan Rynne @ 2020-11-06T12:11:33.407Z: Grasshopper push. (id:afd90f0e47)",
    ReceivedObjectId="52515118040e242f6b65c87b8da7cf9d",
    StreamWrapper="https://staging.speckle.dev/streams/7ed7a7d55e?u=ead7b5bb692081ceb2ed3cde2b088187")  # -> Data, Info
expand_speckle_object = ExpandSpeckleObject(SpeckleObject=receive.Data)
point = Point(Tree({0;0;0}: [Point(0, 0, 0), Point(0, 1, 0), Point(0, 2, 0), Point(0, 3, 0)], {0;0;1}: [Point(1, 0, -0.7342100399), Point(1, 1, -1.312690109), Point(1, 2, 1.046110324), Point(1, 3, 1.008117434)], {0;0;2}: [Point(2, 0, 0), Point(2, 1, 0.8522849393), Point(2, 2, 0), Point(2, 3, -0.7850691057)], {0;0;3}: [Point(3, 0, 0), Point(3, 1, -1.217942681), Point(3, 2, 0), Point(3, 3, 0)]))
surface_from_points = SurfaceFromPoints(Points=flatten(point), UCount=number_slider, Interpolate=False)
create_speckle_object = CreateSpeckleObject(A=surface_from_points)

create_speckle_object_2 = CreateSpeckleObject(A=surface_from_points)  # disabled
serialize = Serialize(O=create_speckle_object_2)  # disabled
deserialize = Deserialize(O=serialize)  # disabled
expand_speckle_object_2 = ExpandSpeckleObject(SpeckleObject=create_speckle_object_2)  # disabled
expand_speckle_object_3 = ExpandSpeckleObject(SpeckleObject=deserialize)  # disabled
panel = Panel(expand_speckle_object_2)  # disabled
panel_2 = Panel(expand_speckle_object_3)  # disabled
surface = Surface(expand_speckle_object_2)  # disabled
surface_2 = Surface(expand_speckle_object_3)  # disabled

send = Send(
    Data=create_speckle_object,
    Stream=id_7ed7a7d55e,
    Branch="main",
    AutoSend=True,
    BaseId="52515118040e242f6b65c87b8da7cf9d",
    CurrentComponentState="up_to_date",
    KitName="Objects",
    OutputWrappers="https://staging.speckle.dev\t7ed7a7d55e\tafd90f0e47",
    UseDefaultCache=False)  # -> Commits, ObjectId, Data

# ---- group: Conversion Nodes
to_speckle = ToSpeckle(Objects=surface_from_points, KitName="Objects")  # disabled
serialize_2 = Serialize(O=to_speckle)  # disabled
deserialize_2 = Deserialize(O=serialize_2)  # disabled
to_native = ToNative(Objects=to_speckle, KitName="Objects")  # disabled
to_native_2 = ToNative(Objects=deserialize_2, KitName="Objects")  # disabled
panel_3 = Panel(to_native)  # disabled
panel_4 = Panel(to_native_2)  # disabled
surface_3 = Surface(to_native)  # disabled
surface_4 = Surface(to_native_2)  # disabled

# ----
panel_5 = Panel(send.Commits)
serialize_3 = Serialize(O=send.Data)
surface_5 = Surface(expand_speckle_object)
panel_6 = Panel(expand_speckle_object)
