# Grasshopper definition TaskCapableObjectManagement.ghx (Grasshopper 1.0.7)
# plug-ins: Speckle 2, Bifocals

series = Series(Start=0, Step=1, Count=10)
series_2 = Series(Start=0, Step=1, Count=10)
sph = Sphere(Base=PlaneXY(0, 0, 0), Radius=series)
box = CenterBox(Base=PlaneXY(0, 0, 0), X=1, Y=1, Z=1)
addition = Addition(A=series_2, B=1)
panel = Panel("B")
panel_2 = Panel("C")
series_3 = Series(Start=0, Step=1, Count=10)
tcso = TCCreateSpeckleObject(Sphere=sph, Box=box, selectedKitName="Objects")
panel_3 = Panel("""A
B
C""")
panel_4 = Panel("""D
E
F""")
msphereex = MeshSphereEx(Base=PlaneXY(0, 0, 0), Radius=10, Count=5)
entwine = Entwine(Branch0X=reverse(series_2), Branch1X=series_2, Branch2X=addition, FlattenInputs=False)  # -> simplify(Result)
entwine_2 = Entwine(Branch0X=panel_3, Branch1X=panel_4, FlattenInputs=False)
sph_2 = Sphere(Base=PlaneXY(0, 0, 0), Radius=1)
eso = ExtendSpeckleObject(SpeckleObject=tcso, A=series_3, B=series_3, C=series_3, selectedKitName="Objects")
eso_k_v = ExtendSpeckleObjectByKeyValue(SpeckleObject=tcso, Keys="@A", Values=msphereex, UseTasks=True, selectedKitName="Objects")
eso_2 = ExpandSpeckleObject(SpeckleObject=tcso, selectedKitName="Objects")  # -> Box, Sphere
tcso_2 = TCCreateSpeckleObject(Sphere=sph_2, selectedKitName="Objects")
entwine_3 = Entwine(FlattenInputs=False)
create_speckle_object_by_key_value = CreateSpeckleObjectByKeyValue(Keys=panel_3, Values=panel_4, selectedKitName="Objects")
eso_3 = ExpandSpeckleObject(SpeckleObject=eso, selectedKitName="Objects")  # -> A, B, Box, C, Sphere
eso_4 = ExpandSpeckleObject(SpeckleObject=tcso_2, selectedKitName="Objects")
object_k_v = SpeckleObjectValueByKey(Object=tcso, Key="box", selectedKitName="Objects")
eso_5 = ExpandSpeckleObject(SpeckleObject=create_speckle_object_by_key_value, selectedKitName="Objects")  # -> A, B, C
eso_6 = ExpandSpeckleObject(SpeckleObject=create_speckle_object_by_key_value, selectedKitName="Objects")  # -> A, B, C
panel_5 = Panel(eso_4)
panel_6 = Panel(eso_3.A)
panel_7 = Panel(eso_5.A)
