# Grasshopper definition KeyValueTest.ghx (Grasshopper 1.0.7)
# plug-ins: Speckle 2

number_slider = Slider(3, range=0..100)
series = Series(Start=0, Step=1, Count=number_slider)  # -> simplify(Series)
series_2 = Series(Start=Slider(5, range=0..10), Step=1, Count=number_slider)  # -> simplify(Series)
entwine = Entwine(Branch0X=graft(series), Branch1X=series_2, FlattenInputs=False)  # -> simplify(Result)
create_object_by_key_value = CreateObjectByKeyValue(Keys=series, Values=graft(series_2))  # -> simplify(Object), Debug
eso = ExpandSpeckleObject(SpeckleObject=simplify(create_object_by_key_value.Object))  # -> _0, _1, _2
panel = Panel(eso._2)
