# Grasshopper definition StreamsTest.ghx (Grasshopper 1.0.7)
# plug-ins: Speckle 2, Bifocals

stream_list = StreamList(Limit=10)
id_44d6505f1b = CreateStream(stream="44d6505f1b http://localhost:3000 c17e3b5af2f177869a733cca10850355")
panel = Panel(id_44d6505f1b)
stream_details = StreamDetails(StreamID=id_44d6505f1b)  # -> StreamID, Name, Description, CreatedAt, UpdatedAt, Public, Collaborators, Branches
stream_update = StreamUpdate(Stream=id_44d6505f1b, Name="hello", Description="hello", Public=Toggle(False))
